# Dynamo graph Home.dyn (Dynamo 1.3.0.875)

file_path = Filename("C:\Program Files\Oasys\GSA 8.7\Samples\Stair.gwb")
openModel = DynaGsa.DynaGsa.OpenModel(file_path)
code_block = CodeBlock { "all"; }
nodeCoordinates = DynaGsa.DynaGsa.NodeCoordinates(openModel, code_block)
